# Grasshopper definition tweetLandscape.ghx (Grasshopper 0.9.76)
# plug-ins: ghJSON

height_gradient_directions_in_degs = Panel("""180
210
270
240
150
90
300
330
120
60
30
0""")
hash_count_x = Slider(4, range=0..10)
hash_count_y = Slider(3, range=0..10)
tweet_count_per_hash_x = Slider(10, range=0..10)
tweet_count_per_hash_y = Slider(10, range=0..10)
tweet_size_x_mm = Slider(100, range=0..500)
tweet_size_y_mm = Slider(150, range=0..500)
tweet_base_height_mm = Slider(25, range=0..100)
character_height_mm = Slider(3, range=0..50)
max_total_height_mm = Slider(125, range=0..500)
noise_amplitude_mm = Slider(20, range=0..50)
clamp_trailing_urls = BooleanToggle(True)
file_path = Panel("D:\Dropbox\Jose Luis\Twipology\10 - DEV\twipology\tweetData\1425754714759_tweets_parsed.json")
dam = DataDam(DataA=character_height_mm, BufferDelay=20000000, BufferMode=2)
dam_2 = DataDam(DataA=file_path, BufferDelay=20000000, BufferMode=2)

file = ReadFile(File=dam_2, PerLineParse=False)
txt = Text(file)

# ----
# USING ghJSON FOR GH:
# http://mathrioshka.ru/ghjson/
panel = Panel("{\"hashArray\":")
concat = Concatenate(FragmentA=panel, FragmentB=txt, FragmentC="}")
frmjson = FromJSON(JSON=concat)

jpath = JSONPath(JObject=frmjson, JSONPathQuery="$.hashArray[*].hashtag")
hashtags = Text(simplify(graft(jpath)))

lng = ListLength(List=jpath)
series = Series(Start=0, Step=1, Count=lng)
int = Integer(series)

concat_2 = Concatenate(FragmentA="$.hashArray[", FragmentB=int, FragmentC="].tweets[*].hashtag_count")
jpath_2 = JSONPath(JObject=frmjson, JSONPathQuery=concat_2)
hashtag_count = Text(simplify(jpath_2))

concat_3 = Concatenate(FragmentA="$.hashArray[", FragmentB=int, FragmentC="].tweets[*].text")
jpath_3 = JSONPath(JObject=frmjson, JSONPathQuery=concat_3)
tweet_text = Text(simplify(jpath_3))

panel_2 = Panel(hashtags)
c_script = CSharpScript(
    hashCountX=hash_count_x,
    hashCountY=hash_count_y,
    tweetCountHashX=tweet_count_per_hash_x,
    tweetCountHashY=tweet_count_per_hash_y,
    tweetSizeX=tweet_size_x_mm,
    tweetSizeY=tweet_size_y_mm,
    tweetBaseHeight=tweet_base_height_mm,
    hashtags=hashtags,
    hashtagCount=hashtag_count,
    tweetText=tweet_text,
    charHeight=dam,
    maxHeight=max_total_height_mm,
    noiseAmplitude=noise_amplitude_mm,
    blockAngle=height_gradient_directions_in_degs,
    clampUrls=clamp_trailing_urls)  # -> out, meshes, twipAnchors; inputs hashCountX: Int32, hashCountY: Int32, tweetCountHashX: Int32, tweetCountHashY: Int32, tweetSizeX: Double, tweetSizeY: Double, tweetBaseHeight: Double, hashtags: tree of String, hashtagCount: tree of Int32, tweetText: tree of String, charHeight: Double, maxHeight: Double, noiseAmplitude: Double, blockAngle: list of Double, clampUrls: Boolean
# ---------- c_script: C# ----------
    Tweet.clampTrailUrls = clampUrls;

    // Compute the maximum number of chars per word
    int maxChars = (int) (Math.Floor((maxHeight - tweetBaseHeight) / charHeight));

    DataTree<Tweet> tweets = new DataTree<Tweet>();

    // iterate over hashtag blocks
    for (int V = 0; V < hashCountY; V++) {
      for (int U = 0; U < hashCountX; U++) {
        int UV = V * hashCountX + U;
        GH_Path UVpath = new GH_Path(UV);

        List<Tweet> twts = new List<Tweet>();
        List<string> tweetTxt = tweetText.Branch(UVpath);
        List<int> hashtagCnt = hashtagCount.Branch(UVpath);
        string hash = hashtags.Branch(UVpath)[0];


        // iterate over tweets in hashtag block
        for (int v = 0; v < tweetCountHashY; v++) {
          for (int u = 0; u < tweetCountHashX; u++) {
            int uv = v * tweetCountHashX + u;

            //double x_ = U * tweetCountHashX * tweetSizeX + u * tweetSizeX;
            //double y_ = V * tweetCountHashY * tweetSizeY + v * tweetSizeY;
            //double z_ = 0;
            double baseElev = tweetBaseHeight;
            string txt = tweetTxt[uv];
            int htC = hashtagCnt[uv];

            //Tweet T = new Tweet(UV, uv, x_, y_, z_, tweetSizeX, tweetSizeY, baseElev, charHeight, maxHeight, noiseAmplitude, hash, htC, txt);
            Tweet T = new Tweet(UV, uv, tweetSizeX, tweetSizeY, baseElev, charHeight, maxChars, noiseAmplitude, hash, htC, txt);
            twts.Add(T);
          }
        }

        // Sort the list according to rounded average chars and then char amplitude
        // http://stackoverflow.com/a/3309397/1934487
        /*twts.Sort(delegate(Tweet t1, Tweet t2) {
        int compareAvg = t1.compareheightAverageInt(t2);
        if (compareAvg == 0) {
        return t1.compareheightAmplitude(t2);
        }
        return compareAvg;
        });*/
        
        // Sort the list according to amplitude and then average
        /*twts.Sort(delegate(Tweet t1, Tweet t2) {
            int compareAmp = t1.compareheightAmplitude(t2);
            if (compareAmp == 0) {
              return t1.compareheightAverage(t2);
            }
            return compareAmp;
          });*/
        
        // Sort the list according to spikyness, amplitude and then average
        twts.Sort(delegate(Tweet t1, Tweet t2) {
            int comp = t1.compareSpikyness(t2);
            if (comp == 0) {
              comp = t1.compareheightAmplitude(t2);
              if (comp == 0) {
                return t1.compareheightAverage(t2);
              } 
            }
            return comp;
          });





        // Create a grid of points
        List<Point3d> anchors = new List<Point3d>();
        for (int v = 0; v < tweetCountHashY; v++) {
          for (int u = 0; u < tweetCountHashX; u++) {
            int uv = v * tweetCountHashX + u;

            double x_ = U * tweetCountHashX * tweetSizeX + u * tweetSizeX;
            double y_ = V * tweetCountHashY * tweetSizeY + v * tweetSizeY;
            double z_ = 0;

            anchors.Add(new Point3d(x_, y_, z_));
          }
        }

        // Sort these points according to block direction
        // compute direction
        double ang = blockAngle[UV] * Math.PI / 180;
        Vector3d dir = new Vector3d(1, 0, 0);
        dir.Rotate(ang, new Vector3d(0, 0, 1));
        Plane proj = Plane.WorldZX;
        proj.Rotate(ang - Math.PI / 2, new Vector3d(0, 0, 1));
        proj.Translate(-100000 * dir);
        // compute ref distances on that direction
        List<Dist> dist = new List<Dist>();
        int counter = 0;
        foreach (Point3d p in anchors) {
          dist.Add(new Dist(proj.DistanceTo(p), counter++));
        }
        // sort distance objs according to value
        dist.Sort(delegate(Dist d1, Dist d2) {
            if (d1.val > d2.val) return 1;
            if (d1.val == d2.val) return 0;
            return -1;
          });
        counter = 0;
        foreach (Dist d in dist) {
          d.indexTarget = counter++;
        }
        // resort back according to targetIndex
        dist.Sort(delegate(Dist d1, Dist d2) {
            if (d1.indexSource > d2.indexSource) return 1;
            if (d1.indexSource == d2.indexSource) return 0;
            return -1;
          });

        // Place tweets in blockgrid according to orientation and their height values
        List<Tweet> sortedTweets = new List<Tweet>();
        for (int v = 0; v < tweetCountHashY; v++) {
          for (int u = 0; u < tweetCountHashX; u++) {
            int uv = v * tweetCountHashX + u;
            Tweet T = twts[dist[uv].indexTarget];
            double x_ = U * tweetCountHashX * tweetSizeX + u * tweetSizeX;
            double y_ = V * tweetCountHashY * tweetSizeY + v * tweetSizeY;
            double z_ = 0;
            T.setAnchor(x_, y_, z_);
            sortedTweets.Add(T);
          }
        }

        tweets.AddRange(sortedTweets, UVpath);
      }

    }




    // Do something with the tweets TEMP
    DataTree<Point3d> tweetAnchors = new DataTree<Point3d>();
    DataTree<Mesh> tweetMeshes = new DataTree<Mesh>();


    // iterate over hashtag blocks
    for (int V = 0; V < hashCountY; V++) {
      for (int U = 0; U < hashCountX; U++) {
        int UV = V * hashCountX + U;
        GH_Path UVpath = new GH_Path(UV);
        List<Tweet> tweetList = tweets.Branch(UVpath);

        // iterate over tweets in hashtag block
        for (int v = 0; v < tweetCountHashY; v++) {
          for (int u = 0; u < tweetCountHashX; u++) {
            int uv = v * tweetCountHashX + u;
            GH_Path uvpath = new GH_Path(UV, uv);

            tweetAnchors.Add(tweetList[uv].anchor, UVpath);
            tweetMeshes.Add(tweetList[uv].mesh, UVpath);

          }
        }

      }
    }


    meshes = tweetMeshes;
    twipAnchors = tweetAnchors;
# ---------- c_script: C# additional code ----------
  public static Random random = new Random();

  // a wrapper to sort distances to ref plane and position index
  class Dist {
    public double val;
    public int indexSource, indexTarget;

    public Dist(double val_, int index_) {
      val = val_;
      indexSource = index_;
    }
  }


  class Tweet {

    public static bool clampTrailUrls = false;

    public int hashId, tweetId;

    public double x, y, z;
    public Point3d anchor;
    public double width, height;
    public double baseElevation, charHeight, noiseAmp;

    public string hashtag;
    public int hashtagCount;
    public string text;
    public int textLength;
    public int wordCount;
    public string[] words;
    public int maxChars;
    public int[] wordChars;
    public double heightMin, heightMax, heightAverage, heightAmplitude;
    public int heightAverageInt;  // an imposed rounding to categorize all similar avgs by amplitude
    public int spikyness;

    public Mesh mesh = new Mesh();

    //public Tweet(int hashId_, int tweetId_, double x_, double y_, double z_, double w, double h, double baseElev, double charH, double maxH, double noiseAmp_, string hash, int hashtagCount_, string txt) {
    public Tweet(int hashId_, int tweetId_, double w, double h, double baseElev, double charH, int maxChars_, double noiseAmp_, string hash, int hashtagCount_, string txt) {
      hashId = hashId_;
      tweetId = tweetId_;
      // x = x_;
      // y = y_;
      // z = z_;
      // anchor = new Point3d(x, y, z);
      width = w;
      height = h;
      baseElevation = baseElev;
      charHeight = charH;
      maxChars = maxChars_;
      noiseAmp = noiseAmp_;
      hashtag = hash;
      hashtagCount = hashtagCount_;
      text = txt;

      parseText();
      computeWave();
      // generateMesh();
    }

    // Read word count, chars per count, etc.
    void parseText() {
      textLength = text.Length;
      words = text.Split(new Char [] {' '});
      wordCount = words.Length;
      wordChars = new int[wordCount];
      for (int i = 0; i < wordCount; i++) {
        int len = words[i].Length;
        wordChars[i] = len > maxChars ? maxChars : len;
      }
      // clamp trailing url if applicable
      if (wordCount > 1 && clampTrailUrls) {
        string lastW = words[wordCount - 1];
        if (lastW.StartsWith("http")) {
          wordChars[wordCount - 1] = wordChars[wordCount - 2];
        }
      }
    }

    // Compute average, amplitude and 'spikyness'
    void computeWave() {
      heightMin = Double.MaxValue;
      heightMax = 0;
      heightAverage = 0;
      for (int i = 0; i < wordChars.Length; i++) {
        int val = wordChars[i];
        if (val > heightMax) heightMax = val;
        if (val < heightMin) heightMin = val;
        heightAverage += val;
      }
      heightAverage /= wordChars.Length;
      heightAverageInt = (int) (Math.Round(heightAverage));
      heightAmplitude = heightMax - heightMin;
      spikyness = 0;
      for (int i = 0; i < wordCount - 1 ; i++) {
        spikyness += Math.Abs(wordChars[i + 1] - wordChars[i]);
      }
    }

    // Generate representing mesh
    void generateMesh() {
      // some sanity
      if (wordCount == 0) {
        generatePlanarMesh(baseElevation);
        return;
      }
      if (wordCount == 1) {
        generatePlanarMesh(baseElevation + wordChars[0] * charHeight);
        return;
      }

      // mesh with +1 words
      bool addNoise = true;
      int stepsX = hashtagCount - 1;
      if (stepsX == 0) {  // if tweet has only one hashtag, don't add noise
        addNoise = false;
        stepsX = 1;
      }
      double gapX = width / stepsX;
      int stepsY = wordCount - 1;
      double gapY = height / stepsY;
      List<Point3d> verts = new List<Point3d>();
      // iterate in Y direction
      for (int i = 0; i < wordCount; i++) {
        for (int j = 0; j < stepsX + 1; j++) {
          double xi = x + gapX * j;
          double yi = y + gapY * i;
          double zi = baseElevation + wordChars[i] * charHeight;
          if (addNoise) {
            zi += noiseAmp * (random.NextDouble() - 0.5);
          }
          //if (zi > maxHeight) zi = maxHeight;
          verts.Add(new Point3d(xi, yi, zi));
        }
      }
      mesh.Vertices.AddVertices(verts);


      for (int i = 0; i < wordCount - 1; i++) {
        for (int j = 0; j < stepsX; j++) {
          int dist = stepsX + 1;
          int uv = dist * i + j;
          mesh.Faces.AddFace(uv, uv + 1, uv + dist + 1, uv + dist);
        }
      }


      mesh.Normals.ComputeNormals();
      mesh.FaceNormals.ComputeFaceNormals();

    }

    // For the case of 0-1 words per tweet
    void generatePlanarMesh(double elevation) {
      List<Point3d> verts = new List<Point3d>();
      verts.Add(new Point3d(anchor.X, anchor.Y, anchor.Z + elevation));
      verts.Add(new Point3d(anchor.X + width, anchor.Y, anchor.Z + elevation));
      verts.Add(new Point3d(anchor.X + width, anchor.Y + height, anchor.Z + elevation));
      verts.Add(new Point3d(anchor.X, anchor.Y + height, anchor.Z + elevation));
      mesh.Vertices.AddVertices(verts);

      mesh.Faces.AddFace(0, 1, 2, 3);

      mesh.Normals.ComputeNormals();
      mesh.FaceNormals.ComputeFaceNormals();

    }

    public void setAnchor(double x_, double y_, double z_) {
      x = x_;
      y = y_;
      z = z_;
      anchor = new Point3d(x, y, z);
      generateMesh();
    }

    // Some comparator functions
    public int compareheightAverage(Tweet other) {
      if (other.heightAverage < this.heightAverage) {
        return 1;
      }
      if (other.heightAverage == this.heightAverage) {
        return 0;
      }
      return -1;
    }
    public int compareheightAverageInt(Tweet other) {
      if (other.heightAverageInt < this.heightAverageInt) {
        return 1;
      }
      if (other.heightAverageInt == this.heightAverageInt) {
        return 0;
      }
      return -1;
    }
    public int compareheightAmplitude(Tweet other) {
      if (other.heightAmplitude < this.heightAmplitude) {
        return 1;
      }
      if (other.heightAmplitude == this.heightAmplitude) {
        return 0;
      }
      return -1;
    }
    public int compareSpikyness(Tweet other) {
      if (other.spikyness < this.spikyness) {
        return 1;
      }
      if (other.spikyness == this.spikyness) {
        return 0;
      }
      return -1;
    }

  }
# ---------- end c_script ----------
geo = Geometry(c_script.meshes)
panel_3 = Panel(c_script.out)
